vi "Main Window.gvi"   [LabVIEW NXG 5.0.0]
panel controls:
  "Acquire Multiple Rainbow Button": bool
  "Load Multiple Measurement": bool
  "Save Multiple Measurement": bool
  "IV Curve Parameters": "IV Curve Parameters.gtype"
  "MRM Cell Selector": "Cell Selector.gtype"
  "Main Tab": i32
  "Custom date": bool
  "Author Initials": string
  "Batch Name": string
  "Cell Number": string
  "Sample Comments": string
  "Abort Button": bool
  "Exit App Button": bool
  "Add Layer Button": bool
  "Add Layer Button_2": bool
  "Add Layer Button_3": bool
panel indicators:
  "IV Plot Out Multiple": "SRM Single Plot Cluster.gtype"[]
  "Current Date": string
  "Progress %": f64
  "State": string
  "Substate": string
  "Sample Prefix": string
  "Progress counter": f64
  "Layer Information": string[]
  "Live IV Parameters": T2
types:
  "SRM Single Plot Cluster.gtype" = cluster{"Voltage (V)": f64[], "Current Density (A/m^2)": f64[]}
  "IV Mode.gtype" = enum{"Rough", "Normal", "Accurate", "Smart"}
  "IV Curve Parameters.gtype" = cluster{"Max (V)": f64, "Min (V)": f64, "V Points": u32, "Curr Range (A)": f64, "Sweep Dir": bool, "Current Avg": u32, "Max (A)": f64, "Integration Time": f64, "Autorange": bool, "Cell Area (m^2)": f64, "Light Power (W m^-2)": f64, "Iterations": u32, "IV Mode": "IV Mode.gtype"}
  T1 = cluster{"L.01": bool, "R.01": bool, "L.02": bool, "R.02": bool, "L.03": bool, "R.03": bool, "L.04": bool, "R.04": bool, "L.05": bool, "R.05": bool, "L.06": bool, "R.06": bool, "L.07": bool, "R.07": bool, "L.08": bool, "R.08": bool, "L.09": bool, "R.09": bool, "L.10": bool, "R.10": bool, "L.11": bool, "R.11": bool, "L.12": bool, "R.12": bool}
  "Cell Selector.gtype" = cluster{"All": bool, "Left": bool, "Right": bool, "Cell Cluster": T1, "Reset": bool, "Random Order ": bool, "Reset_2": bool}
  T2 = cluster{"Current (A)": f64, "Voltage (V)": f64, "Current Density (A/m^2)": f64, "Current Cell": enum{""}}
  "Queue Instructions Control.gtype" = enum{"Undefined State", "Debug Check", "Initialize App", "Idle", "Change Cell", "IV Curve", "Saving TXT Files", "Generating Origin Files", "Stopping App", "State 1", "State2", "State3", "State4", "State5"}
uses:
  Pika IV Characterization NXG::Side Functions::Abort Control::FGV Global Abort.gvi
  Pika IV Characterization NXG::Main Functions::Instruction Handling::FGV Current State.gvi
  NI::G Core::Error::Is Error.gvi
  Rainbow Measurement Setup::Side Functions::Global Abort::Global Abort Sequence.gvi
  NI::G Core::Error::Multiplex Errors.gvi
  NI::G Core::Error::Display Error.gvi
diagram:
  call "FGV Global Abort.gvi"(Global Abort Instructions="Reset State") -> (Error Out=w1)
  call "FGV Current State.gvi"(Current State Instructions="Set Current State and Substate", Current State="Undefined State", Current Substate="Starting Up", Error In=w1) -> (Error Out=w2)
  Obtain Queue(create if not found=TRUE, element data type="Queue Instructions Control.gtype" "Undefined State", error in=w2, name="Instruction Queue") -> (error out=w3, queue out=w4)
  Enqueue Element(element="Debug Check", error in=w3, queue=w4) -> (error out=w5, queue out=w6)
  s1 = w6  # shift register
  while {
    event (timeout = 50) {
      on "Timeout" {
        w7 = w5
        w8 = s1
        w9 = default
      }
    }
    call "Is Error.gvi"(error in=w7) -> (error?=w10)
    Logical Or(w10, w9) -> w11
    next s1 = w8
    stop if w11
  }
  s2 = w6  # shift register
  while {
    Dequeue Element(error in=w5, queue=s2) -> (element=w12, error out=w13, queue out=w14)
    case (w12) {
      frame "Undefined State", Default {
        w15 = _
        w16 = _
        w17 = default
      }
      frame "Debug Check" {
        w15 = w13
        w16 = w14
        w17 = default
      }
      frame "Stopping App" {
        w15 = _
        w16 = _
        w17 = TRUE
      }
    }
    call "Is Error.gvi"(error in=w15) -> (error?=w18)
    Logical Or(w18, w17) -> w19
    call "FGV Global Abort.gvi"(Global Abort Instructions="Reset State", Global Abort=w19, Error In=w15) -> (Error Out=w20)
    next s2 = w16
    stop if w19
  }
  Enqueue Element(element="Stopping App", error in=w20, queue=s2) -> (error out=w21)
  s3 = w6  # shift register
  s4 = w5  # shift register
  while {
    event (timeout = 100) {
      on "Timeout" {
        call "FGV Global Abort.gvi"(Global Abort Instructions="Read Current State", Error In=s4) -> (Global Abort Out=w25, Error Out=w26)
        Preview Queue Element(error in=w26, queue=s3, timeout in ms=100) -> (element=w27, error out=w22, queue out=w23)
        Is Equal(x=w27, y="Stopping App") -> w28
        Logical Or(w28, w25) -> w24
      }
      on "Abort Button" Value changed {
        call "Global Abort Sequence.gvi"(Queue In=s3, Global Abort=_, Error In=s4) -> (Queue Out=w23, Error Out=w22)
        w24 = default
      }
    }
    next s3 = w23
    next s4 = w22
    stop if w24
  }
  Enqueue Element(element="Stopping App", error in=s4, queue=s3) -> (error out=w29)
  call "Multiplex Errors.gvi"(error in 1=w7, error in 2=w21, error in 3=w29) -> (error out=w30)
  Flush Queue(error in=w30, queue=s1) -> (error out=w31, queue out=w32)
  Release Queue(error in=w31, queue=w32) -> (error out=w33)
  case (w33) {
    frame Error, Default {
      # In case there is an error
      # put out an error handler
      call "Display Error.gvi"(error in=w33)
    }
    frame No Error { }
  }
